# Grasshopper definition kagome.gh (Grasshopper 0.9.76)
# plug-ins: MeshEdit Components, Python Interpreter, LunchBox

# ----
# Generating a coarse triangulated mesh around the skeleton of a node
crv = Curve([<curve referenced from the Rhino model> x4])
weaving = PythonScript(lines=crv)  # -> out, coarse_node_tri_mesh; inputs lines: list
# ---------- weaving: Python ----------
import rhinoscriptsyntax as rs
from compas.utilities import average
from compas_pattern.datastructures.kagome.kagome import Kagome
from compas_pattern.cad.rhino.draw import draw_mesh

size = average([rs.CurveLength(line) for line in lines]) / 2
lines = [(rs.CurveStartPoint(line), rs.CurveEndPoint(line)) for line in lines]
mesh = Kagome.from_skeleton(lines, size)
coarse_node_tri_mesh = draw_mesh(mesh)
# ---------- end weaving ----------
mesh = Mesh(weaving.coarse_node_tri_mesh)

# ----
# Starting with a structured triangulated mesh
srf = Surface(<surface referenced from the Rhino model>)
# INPUT
mesh_uv = MeshSurface(Surface=srf, UCount=1, VCount=1, Overhang=True, Equalize=False)
tri = Triangulate(Mesh=mesh_uv)  # -> Mesh, Count

# ----
# Starting with a Delaunay mesh
pt = Point([<point referenced from the Rhino model> x9])
del = DelaunayMesh(Points=pt, Plane=PlaneXY(0, 0, 0))

# ----
# Generating a Kagome pattern for triaxial weaving from a mesh
density = Slider(3, range=0..10)
# PATTERNING
mesh_2 = Mesh(del)
weaving_2 = PythonScript(coarse_tri_mesh=mesh_2, density=density)  # -> out, pattern
# ---------- weaving_2: Python ----------
from compas_rhino.geometry import RhinoMesh
from compas_pattern.datastructures.kagome.kagome import Kagome

pattern = Kagome.from_vertices_and_faces(*RhinoMesh.from_guid(coarse_tri_mesh).get_vertices_and_faces())
pattern.densification(int(density))
pattern.patterning()
pattern.store_kagome_polyedge_data()
# ---------- end weaving_2 ----------

# ----
# UNBUILD AND REBUILD
# FOR FORM FINDING USING LINES
# geometrical
# processing
# of lines
python = PythonScript(pattern=weaving_2.pattern)  # -> out, lines
# ---------- python: Python ----------
import rhinoscriptsyntax as rs

lines = [rs.AddLine(pattern.kagome.vertex_coordinates(u), pattern.kagome.vertex_coordinates(v)) for u, v in pattern.kagome.edges()]
# ---------- end python ----------
crv_2 = Curve(python.lines)
python_2 = PythonScript(lines=crv_2)  # -> out, pattern; inputs lines: list
# ---------- python_2: Python ----------
import rhinoscriptsyntax as rs
from compas_pattern.datastructures.kagome.kagome import Kagome

lines = [(rs.CurveStartPoint(line), rs.CurveEndPoint(line)) for line in lines]
pattern = Kagome.from_lines(lines, delete_boundary_face=True)
pattern.kagome = pattern.copy()
pattern.store_kagome_polyedge_data()
print pattern.kagome.number_of_edges()
# ---------- end python_2 ----------

# ----
# Kagome
data = Data(python_2.pattern)

# ----
# Kagome strip weaving
weaving_3 = PythonScript(pattern=data)  # -> out, strip_directions
# ---------- weaving_3: Python ----------
import rhinoscriptsyntax as rs
from Grasshopper.Kernel.Data import GH_Path
from Grasshopper import DataTree

strip_directions = DataTree[object]()
for i, polyline in enumerate(pattern.kagome_polyedge_weaving()):
    for j, direction in enumerate(polyline):
       path = GH_Path(i, j)
       strip_directions.Add(direction, path)
# ---------- end weaving_3 ----------
# Kagome strip frames
weaving_4 = PythonScript(pattern=data)  # -> out, strip_frames
# ---------- weaving_4: Python ----------
import rhinoscriptsyntax as rs
from Grasshopper.Kernel.Data import GH_Path
from Grasshopper import DataTree

strip_frames = DataTree[object]()
for i, polyline in enumerate(pattern.kagome_polyline_frames()):
    for j, frame in enumerate(polyline):
       path = GH_Path(i, j)
       strip_frames.AddRange([rs.AddPoint(vector) for vector in frame], path)
# ---------- end weaving_4 ----------
# DATA
# Kagome strip polylines
weaving_5 = PythonScript(pattern=data)  # -> out, strip_polylines
# ---------- weaving_5: Python ----------
import rhinoscriptsyntax as rs
from Grasshopper.Kernel.Data import GH_Path
from Grasshopper import DataTree
print pattern.kagome.number_of_edges()
strip_polylines = DataTree[object]()
for i, polyline in enumerate(pattern.kagome_polylines()):
    for j, point in enumerate(polyline):
        path = GH_Path(i, j)
        strip_polylines.Add(rs.AddPoint(point), path)
# ---------- end weaving_5 ----------
# Kagome strip colours
weaving_6 = PythonScript(pattern=data)  # -> out, strip_colours
# ---------- weaving_6: Python ----------
import rhinoscriptsyntax as rs
from Grasshopper.Kernel.Data import GH_Path
from Grasshopper import DataTree

polyline_colour = pattern.kagome_polyedge_colouring_2()

strip_colours = DataTree[object]()
for i, colour in enumerate(polyline_colour):
    strip_colours.Add(colour, GH_Path(i))
# ---------- end weaving_6 ----------
# Kagome singularities
weaving_7 = PythonScript(pattern=data)  # -> out, singular_faces
# ---------- weaving_7: Python ----------
import rhinoscriptsyntax as rs

#singular_faces = pattern.kagome_singularities()
print pattern.kagome_singularities()
singular_faces = [rs.AddPolyline(polyline) for polyline in pattern.kagome_singularities()]
#singularities = [rs.AddPoint(point) for point in pattern.singularity_points()]
# ---------- end weaving_7 ----------

# ----
# Offset polylines for weaving
thickness = Slider(0.02, range=0..0.1)
item = ListItem(List=weaving_4.strip_frames, Index=0, Wrap=True)
trim = TrimTree(Tree=weaving_3.strip_directions, Depth=1)
# PROCESSING
trim_2 = TrimTree(Tree=weaving_5.strip_polylines, Depth=1)
trim_3 = TrimTree(Tree=item, Depth=1)
multiplication = Multiplication(A=trim, B=thickness)
lng = ListLength(List=trim_3)
num = Number(multiplication)
repeat = RepeatData(Data=num, Length=lng)
multiplication_2 = Multiplication(A=trim_3, B=repeat)
move = Move(Geometry=trim_2, Motion=multiplication_2)  # -> simplify(graft(Geometry)), Transform

# ----
# Visualise singularities
crv_3 = Curve(graft(weaving_7.singular_faces))
patch = Patch(Curves=crv_3, Spans=20, Flexibility=1, Trim=True)
preview = CustomPreview(Geometry=patch, Shader=ColourSwatch(SwatchColor=RGB(255, 255, 255)))

data_2 = Data(move.Geometry)

# ----
# Build strips
width = Slider(0.03, range=0..0.1)
item_2 = ListItem(List=weaving_4.strip_frames, Index=2, Wrap=True)
division = Division(A=width, B=2)
multiplication_3 = Multiplication(A=division, B=-1)
multiplication_4 = Multiplication(A=item_2, B=[multiplication_3, division])
move_2 = Move(Geometry=data_2, Motion=multiplication_4)  # -> Geometry, Transform
item_3 = ListItem(List=move_2.Geometry, Index=0, Wrap=True)  # -> Item, Item1
ln = Line(StartPoint=item_3.Item, EndPoint=item_3.Item1)
trim_4 = TrimTree(Tree=ln, Depth=1)
lng_2 = ListLength(List=trim_4)
subtraction = Subtraction(A=lng_2, B=1)
split = SplitList(List=trim_4, Index=subtraction)  # -> simplify(ListA), ListB
shift = ShiftList(List=trim_4, Shift=1, Wrap=False)  # -> simplify(List)
end = EndPoints(Curve=split.ListA)  # -> graft(Start), graft(End)
end_2 = EndPoints(Curve=shift)  # -> graft(Start), graft(End)
merge = Merge(Data1=end.Start, Data2=end.End, Data3=end_2.End, Data4=end_2.Start)
conmesh = ConstructMesh(Vertices=merge, Faces={A=0, B=1, C=2, D=3})
trim_5 = TrimTree(Tree=conmesh, Depth=1)
mjoin = MeshJoin(Meshes=trim_5)
weldvertices = MeshWeldVertices(Mesh=mjoin, Tolerance=0.01)  # -> RuntimeMessage, Mesh
mesh_3 = Mesh(flatten(weldvertices.Mesh))

# ----
# Visualise frames
number_slider = Slider(0, range=0..2)
item_4 = ListItem(List=weaving_4.strip_frames, Index=number_slider, Wrap=True)
vdis = VectorDisplay(Anchor=data_2, Vector=item_4)

# ----
# Build polylines
trim_6 = TrimTree(Tree=data_2, Depth=1)
pline = PolyLine(Vertices=trim_6, Closed=False)
crv_4 = Curve(pline)

# ----
# Colour strips
bnd = Bounds(Numbers=flatten(weaving_6.strip_colours))
dedomain = DeconstructDomain(Domain=bnd)  # -> Start, End
gradient = Gradient(
    LowerLimit=dedomain.Start,
    UpperLimit=dedomain.End,
    Parameter=weaving_6.strip_colours,
    stops=[0: RGB(234, 38, 0), 0.25: RGB(234, 126, 0), 0.5: RGB(254, 244, 84), 0.75: RGB(173, 203, 249), 1: RGB(75, 107, 169)])
preview_2 = CustomPreview(Geometry=graft(mesh_3), Shader=gradient)

# ----
# Bake strips per group with colour in layers
panel = Panel("strip_group_")
txt = Text(flatten(weaving_6.strip_colours))
concat = Concatenate(FragmentA=panel, FragmentB=txt)
bake = ObjectBake(
    BakeToggle=Button(),
    GeometryObjects=mesh_3,
    Layer=concat,
    ObjectName="GH_Obj",
    ObjectColor=flatten(gradient),
    LayerColor=RGB(255, 255, 255))
