# Grasshopper definition 03_surface_quad_meshing.gh (Grasshopper 1.0.7)

tolerance_value = Slider(0.5, range=0..1)
# singular | compas_pattern
# Surface quad-meshing
# Robin Oval
# rpho2@cam.ac.uk
# https://github.com/BlockResearchGroup/compas_pattern
srf = Surface(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)

crv = Curve()
pt = Point([Point(4.67783024, 0.3459388189, 1.951780041), Point(3.176917069, 5.551557034, 3.253131615)])

srfquaddec = SurfaceQuadDecomposition(surface_guid=srf, accuracy_value=tolerance_value, point_guids=pt)  # -> quad_mesh; inputs point_guids: list, curve_guids: list
# ---------- srfquaddec: Python ----------
from compas_pattern.rhino.grasshopper import gh_surface_decomposition
quad_mesh = gh_surface_decomposition(surface_guid, accuracy_value, point_guids, curve_guids)
# ---------- end srfquaddec ----------
storestrips = StoreStrips(quad_mesh=srfquaddec)  # -> quad_mesh
# ---------- storestrips: Python ----------
from compas_pattern.rhino.grasshopper import gh_store_strips
quad_mesh = gh_store_strips(quad_mesh)
# ---------- end storestrips ----------
vertices = MeshVertices(mesh=storestrips)  # -> vertex_coordinates
# ---------- vertices: Python ----------
from compas_pattern.rhino.grasshopper import gh_vertices
vertex_coordinates = gh_vertices(mesh)
# ---------- end vertices ----------
strips = QuadMeshStrips(quad_mesh=storestrips)  # -> strip_edges, strip_closed
# ---------- strips: Python ----------
from compas_pattern.rhino.grasshopper import gh_strips
strip_edges, strip_closed = gh_strips(quad_mesh)
# ---------- end strips ----------
item = ListItem(List=vertices, Index=strips.strip_edges, Wrap=True)
item_2 = ListItem(List=item, Index=0, Wrap=True)  # -> Item, Item1
ln = Line(StartPoint=item_2.Item, EndPoint=item_2.Item1)
trim = TrimTree(Tree=ln, Depth=1)
len = Length(Curve=trim)
avr = Average(Input=len)
division = Division(A=avr, B=Slider(0.4, range=0..2))
max = Maximum(A=division, B=Slider(1, range=0..10))  # -> flatten(Result)
int = Integer(max)
densify = DensifyQuadMesh(quad_mesh=storestrips, strips_subdivision=int)  # -> dense_quad_mesh; inputs strips_subdivision: list of Int32
# ---------- densify: Python ----------
from compas_pattern.rhino.grasshopper import gh_densifiying
dense_quad_mesh = gh_densifiying(quad_mesh, strips_subdivision)
# ---------- end densify ----------

k = Slider(20, range=0..100)
d = Slider(0.5, range=0..1)

srf_2 = Surface(srf)
pt_2 = Point(pt)
cstrsmoothing = ConstrainedLaplacianSmoothing(mesh=densify, k=k, d=d, surface_constraint=srf_2, point_constraints=pt_2)  # -> smooth_mesh; inputs k: Int32, point_constraints: list
# ---------- cstrsmoothing: Python ----------
from compas_pattern.rhino.grasshopper import gh_constrained_smoothing
smooth_mesh = gh_constrained_smoothing(mesh, k=k, damping=d, surface_constraint=surface_constraint, point_constraints=point_constraints)
# ---------- end cstrsmoothing ----------
torhinomesh = ToRhinoMesh(mesh=cstrsmoothing)  # -> mesh_guid
# ---------- torhinomesh: Python ----------
from compas_pattern.rhino.grasshopper import gh_to_rhino_mesh
mesh_guid = gh_to_rhino_mesh(mesh)
# ---------- end torhinomesh ----------
mesh = Mesh(torhinomesh)
