# Grasshopper definition 04_quad_mesh_topological_edit.gh (Grasshopper 1.0.7)

# singular | compas_pattern
# Quad-mesh topological edit
# Robin Oval
# rpho2@cam.ac.uk
# https://github.com/BlockResearchGroup/compas_pattern
mesh = Mesh(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)
fromrhinomesh = FromRhinoMesh(mesh_guid=mesh)  # -> mesh
# ---------- fromrhinomesh: Python ----------
from compas_pattern.rhino.grasshopper import gh_from_rhino_mesh
mesh = gh_from_rhino_mesh(mesh_guid)
# ---------- end fromrhinomesh ----------
storestrips = StoreStrips(quad_mesh=fromrhinomesh)  # -> quad_mesh
# ---------- storestrips: Python ----------
from compas_pattern.rhino.grasshopper import gh_store_strips
quad_mesh = gh_store_strips(quad_mesh)
# ---------- end storestrips ----------
vertices = MeshVertices(mesh=storestrips)  # -> vertex_coordinates
# ---------- vertices: Python ----------
from compas_pattern.rhino.grasshopper import gh_vertices
vertex_coordinates = gh_vertices(mesh)
# ---------- end vertices ----------
strips = QuadMeshStrips(quad_mesh=storestrips)  # -> strip_edges, strip_closed
# ---------- strips: Python ----------
from compas_pattern.rhino.grasshopper import gh_strips
strip_edges, strip_closed = gh_strips(quad_mesh)
# ---------- end strips ----------
item = ListItem(List=vertices, Index=strips.strip_edges, Wrap=True)
points = PointList(Points=vertices, Size=0.35)
item_2 = ListItem(List=item, Index=0, Wrap=True)  # -> Item, Item1

panel = Panel("""2
4
7""")
panel_2 = Panel("""15
14
13
17""")

ln = Line(StartPoint=item_2.Item, EndPoint=item_2.Item1)
panel_3 = Panel("""3
8""")
trim = TrimTree(Tree=ln, Depth=1)
entwine = Entwine(Branch00=panel, Branch01=panel_2, FlattenInputs=True)  # -> simplify(Result)
curvepoint = PointOnCurve(trim, parameter=0.5)
editstrip = EditQuadMeshStripTopology(mesh=storestrips, polyedges_to_add=entwine, strips_to_delete=panel_3)  # -> edited_mesh; inputs polyedges_to_add: tree of Int32, strips_to_delete: list of Int32
# ---------- editstrip: Python ----------
from compas_pattern.rhino.grasshopper import gh_add_delete_strips
edited_mesh = gh_add_delete_strips(mesh, polyedges_to_add, strips_to_delete)
# ---------- end editstrip ----------
pline = PolyLine(Vertices=curvepoint, Closed=strips.strip_closed)  # -> flatten(Polyline)
torhinomesh = ToRhinoMesh(mesh=editstrip)  # -> mesh_guid
# ---------- torhinomesh: Python ----------
from compas_pattern.rhino.grasshopper import gh_to_rhino_mesh
mesh_guid = gh_to_rhino_mesh(mesh)
# ---------- end torhinomesh ----------
curvepoint_2 = PointOnCurve(pline, parameter=0.5)
preview = CustomPreview(Geometry=pline, Material=ColourSwatch(SwatchColor=RGB(0, 0, 255)))
faces = MeshFaces(mesh=editstrip)  # -> face_vertices
# ---------- faces: Python ----------
from compas_pattern.rhino.grasshopper import gh_faces
face_vertices = gh_faces(mesh)
# ---------- end faces ----------
torhinomesh_2 = ToRhinoMesh(mesh=editstrip)  # -> out, mesh_guid; same code as torhinomesh
points_2 = PointList(Points=curvepoint_2, Size=0.5)
panel_4 = Panel(torhinomesh_2.out)

k = Slider(3, range=0..100)
d = Slider(0.5, range=0..1)

srf = Surface(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)
data = Data(editstrip)
python = GhPythonScript(mesh=data)  # -> vertex_on_boundary, face_on_boundary, edge_on_boundary
# ---------- python: Python ----------
from compas_pattern.rhino.grasshopper import gh_boundary_elements
vertex_on_boundary, face_on_boundary, edge_on_boundary = gh_boundary_elements(mesh)
# ---------- end python ----------
vertices_2 = MeshVertices(mesh=data)  # -> vertex_coordinates; same code as vertices
debrep = DeconstructBrep(Brep=srf)  # -> Faces, Edges, Vertices
data_2 = Data(fromrhinomesh)
item_3 = ListItem(List=vertices_2, Index=python.vertex_on_boundary, Wrap=True)
lng = ListLength(List=python.vertex_on_boundary)
repeat = RepeatData(Data=graft(debrep.Edges), Length=lng)  # -> simplify(Data)
crv_cp = CurveClosestPoint(Point=graft(vertices_2), Curve=debrep.Edges)  # -> Point, Parameter, Distance
flip = FlipMatrix(Data=repeat)
X = UnitX(Factor="11")
sort = SortList(Keys=simplify(crv_cp.Distance), ValuesA=flip)  # -> Keys, ValuesA
series = Series(Start=0, Step=1, Count=lng)
item_4 = ListItem(List=sort.ValuesA, Index=0, Wrap=True)  # -> flatten(Item)
repeat_2 = RepeatData(Data=debrep.Faces, Length=lng)
dispatch = Dispatch(List=series, DispatchPattern=python.vertex_on_boundary)  # -> ListA, ListB
dispatch_2 = Dispatch(List=item_4, DispatchPattern=python.vertex_on_boundary)  # -> ListA, ListB
replace = ReplaceItems(List=repeat_2, Item=dispatch_2.ListA, Indices=dispatch.ListA, Wrap=False)
cp = ClosestPoint(Point=debrep.Vertices, Cloud=vertices_2)  # -> ClosestPoint, CPIndex, Distance
replace_2 = ReplaceItems(List=replace, Item=debrep.Vertices, Indices=cp.CPIndex, Wrap=False)
cstrsmoothing = ConstrainedLaplacianSmoothing(mesh=editstrip, k=k, d=d, guid_constraints=replace_2)  # -> smooth_mesh; inputs k: Int32, guid_constraints: list
# ---------- cstrsmoothing: Python ----------
from compas_pattern.rhino.grasshopper import gh_constrained_smoothing
smooth_mesh = gh_constrained_smoothing(mesh, k, d, guid_constraints)
# ---------- end cstrsmoothing ----------
vertices_3 = MeshVertices(mesh=cstrsmoothing)  # -> vertex_coordinates; same code as vertices
torhinomesh_3 = ToRhinoMesh(mesh=cstrsmoothing)  # -> mesh_guid; same code as torhinomesh
lng_2 = ListLength(List=vertices_3)
mesh_2 = Mesh(torhinomesh_3)
repeat_3 = RepeatData(Data=X, Length=lng_2)
python_2 = GhPythonScript(mesh=cstrsmoothing, vectors=repeat_3)  # -> out, moved_mesh; inputs vectors: list
# ---------- python_2: Python ----------
from compas_pattern.rhino.grasshopper import gh_move_vertices
#moved_mesh = gh_move_vertices(mesh, vectors)
#print(moved_mesh)

from copy import deepcopy
from compas_pattern.datastructures import mesh_move_vertices_by
moved_mesh = deepcopy(mesh)
key_to_vector = {vkey: vector for vkey, vector in zip(moved_mesh.vertices(), vectors)}
mesh_move_vertices_by(moved_mesh, key_to_vector)
# ---------- end python_2 ----------
vertices_4 = MeshVertices(mesh=python_2.moved_mesh)  # -> vertex_coordinates; same code as vertices
singularities = QuadMeshSingularities(quad_mesh=python_2.moved_mesh)  # -> singularities
# ---------- singularities: Python ----------
from compas_pattern.rhino.grasshopper import gh_singularities
singularities = gh_singularities(quad_mesh)
# ---------- end singularities ----------
torhinomesh_4 = ToRhinoMesh(mesh=python_2.moved_mesh)  # -> mesh_guid; same code as torhinomesh
item_5 = ListItem(List=vertices_4, Index=singularities, Wrap=True)
circle = CircleCNR(Center=item_5, Normal=Vector(0, 0, 1), Radius=Slider(0.2, range=0..1))
mesh_3 = Mesh(torhinomesh_4)
boundary = BoundarySurfaces(Edges=circle)
preview_2 = CustomPreview(Geometry=boundary, Material=ColourSwatch(SwatchColor=RGB(255, 0, 255)))
